# Grasshopper definition annotation_test.gh (Grasshopper 1.0.7)
# plug-ins: GrasshopperPRT

path = FilePath("C:\Users\lor11212\Documents\Rhino\rhino-plugin-prototype\TestCases\annotations_test.rpk")
rec = Rectangle({Plane=PlaneXY(2, 13, 0), Size=Domain2(u=-13..13, v=-19..19)})
ghprt = GrasshopperPRT(PathToRPK=path, InitialShapes=rec, DefaultEnumBool=Toggle(False))  # -> GeneratedShapes, Materials, Reports
