# Grasshopper definition report01_test.gh (Grasshopper 1.0.7)
# plug-ins: GrasshopperPRT

rec = Rectangle([{Plane=PlaneXY(-33, 27, 0), Size=Domain2(u=-12..12, v=-13..13)}, {Plane=PlaneXY(30, 29.5, 0), Size=Domain2(u=-15..15, v=-14.5..14.5)}])
path = FilePath("C:\Users\lor11212\Documents\Rhino\rhino-plugin-prototype\TestCases\reporting_01.rpk")
panel = Panel("""Area.BuildUp_avg
Area.BuildUp_n""")
ghprt = GrasshopperPRT(PathToRPK=path, InitialShapes=rec)  # -> GeneratedShapes, Materials, Reports
txt = Text(Tree({0}: ["869.999839186088", "1", "2", "3"], {1}: ["1", "2", "3"]))
cga_reports_display = GrasshopperPRTReports(
    Meshes=ghprt.GeneratedShapes,
    Reports=ghprt.Reports,
    ShapeIDFilter=Domain(-1.234321012e+308, -1.234321012e+308),
    ReportKeyFilter=panel,
    ReportValueFilter=txt)  # -> ReportsLocation, ReportsDisplay, Reports
tag = TextTag3D(Location=cga_reports_display.ReportsLocation, Text=cga_reports_display.ReportsDisplay, Size=1, Justification=7)
reports_outputs = GrasshopperPRTReportsOutput(Reports=cga_reports_display.Reports)  # -> ReportName, ShapeID, ReportValue
panel_2 = Panel(reports_outputs.ReportName)
panel_3 = Panel(reports_outputs.ShapeID)
panel_4 = Panel(reports_outputs.ReportValue)
